# Dynamo graph 20250613 - Python Node.dyn (Dynamo 2.19.3.6394)

# note: 選取複數Element
select_model_elements = DSModelElementsSelection()  # 47 picked in the model
solids = Element.Solids(element=select_model_elements)
# note: 將各個Solid組合成一個Solid，
# 同時處理多個Solid資料
byUnion = Solid.ByUnion(solids=solids)
# note: input改成use level並調整L
byGeometry = BoundingBox.ByGeometry(geom=byUnion@L1)
# note: 把多個BoundingBox組合成一個
toCuboid = BoundingBox.ToCuboid(boundingBox=byGeometry)  # frozen
code_block = CodeBlock { 0; 1; 2; }  # frozen
getItemAtIndex = List.GetItemAtIndex(list=solids, index=code_block.out1)
getItemAtIndex_2 = List.GetItemAtIndex(list=solids, index=code_block.out2)
getItemAtIndex_3 = List.GetItemAtIndex(list=solids, index=code_block.out0)
area = Solid.Area(solid=byUnion)  # frozen
watch = Watch(area)
# note: 注意Dynamo中的單位設定
volume = Solid.Volume(solid=byUnion)  # frozen
watch_2 = Watch(volume)
# note: 與元件放置基準點(Location)不同
centroid = Solid.Centroid(solid=byUnion)  # frozen
watch_3 = Watch(centroid)
maxPoint = BoundingBox.MaxPoint(boundingBox=byGeometry)
Z = Point.Z(point=maxPoint)
minPoint = BoundingBox.MinPoint(boundingBox=byGeometry)
Z_2 = Point.Z(point=minPoint)
# note: 設定數值區間
code_block_2 = CodeBlock { 600; 1000; }

# group: Dynamo Basic Node
# note: 計算Z值相減(高度)
sub = Z - Z_2
lt = sub < code_block_2.out0
# note: 輸入原始的Element並加入遮罩篩選結果
filterByBoolMask = List.FilterByBoolMask(list=select_model_elements, mask=lt)
# note: 判斷數值區間
ge = sub >= code_block_2.out0
le = sub <= code_block_2.out1
and_ = ge && le
filterByBoolMask_2 = List.FilterByBoolMask(list=select_model_elements, mask=and_)
gt = sub > code_block_2.out1
filterByBoolMask_3 = List.FilterByBoolMask(list=select_model_elements, mask=gt)

color_palette = ColorPalette({R: 255, G: 0, B: 0, A: 255})
# note: 在模型中上色
overrideColorInView = Element.OverrideColorInView(element=filterByBoolMask.in, color=color_palette)
color_palette_2 = ColorPalette({R: 0, G: 254, B: 63, A: 255})
overrideColorInView_2 = Element.OverrideColorInView(element=filterByBoolMask_2.in, color=color_palette_2)
color_palette_3 = ColorPalette({R: 0, G: 67, B: 255, A: 255})
overrideColorInView_3 = Element.OverrideColorInView(element=filterByBoolMask_3.in, color=color_palette_3)
python_script = Python(IN[0]=code_block_2.out0, IN[1]=code_block_2.out1, IN[2]=Z_2, IN[3]=Z, IN[4]=select_model_elements)  # CPython3
# ---------- python_script.python (24 lines) ----------
lowerLimit = IN[0] #double
upperLimit = IN[1] #double
equBottomPointZ = IN[2] #double
equTopPointZ = IN[3] #double
elements = IN[4] #List<Element>

OUT = [[], [], []] #定義Python Node 輸出格式

#針對每個element做for迴圈運算
for i in range(len(elements)): 
    
    clearHeight = equTopPointZ[i] - equBottomPointZ[i]
    
    #clearHeight 比 lowerLimit 更低
    if clearHeight < lowerLimit:
        OUT[0].append(elements[i])
                
    #clearHeight 介於 lowerLimit 與 upperLimit
    elif (clearHeight > lowerLimit) and (clearHeight < upperLimit):
        OUT[1].append(elements[i])
        
    #clearHeight 比 upperLimit 更高
    elif clearHeight > upperLimit:
        OUT[2].append(elements[i])
# ----------------------------------------
code_block_3 = CodeBlock(L=python_script) { L[1]; }
color_palette_4 = ColorPalette({R: 0, G: 254, B: 63, A: 255})
overrideColorInView_4 = Element.OverrideColorInView(element=code_block_3, color=color_palette_4)
code_block_4 = CodeBlock(L=python_script) { L[2]; }
color_palette_5 = ColorPalette({R: 0, G: 67, B: 255, A: 255})
overrideColorInView_5 = Element.OverrideColorInView(element=code_block_4, color=color_palette_5)
code_block_5 = CodeBlock(L=python_script) { L[0]; }
color_palette_6 = ColorPalette({R: 255, G: 0, B: 0, A: 255})
overrideColorInView_6 = Element.OverrideColorInView(element=code_block_5, color=color_palette_6)
