# Dynamo graph Data Type.dyn (Dynamo 2.19.3.6394)

select_model_element = DSModelElementSelection()  # 1 picked in the model
watch = Watch(select_model_element)
select_model_element_2 = DSModelElementSelection()  # 1 picked in the model
id = Element.Id(element=select_model_element_2)
watch_2 = Watch(id)
getCategory = Element.GetCategory(element=select_model_element_2)
watch_3 = Watch(getCategory)
geometry = Element.Geometry(element=select_model_element_2)
watch_4 = Watch(geometry)
elementType = Element.ElementType(element=select_model_element_2)
watch_5 = Watch(elementType)
name = Element.Name(element=select_model_element_2)
watch_6 = Watch(name)
select_model_element_3 = DSModelElementSelection()  # 1 picked in the model
solids = Element.Solids(element=select_model_element_3)
byUnion = Solid.ByUnion(solids=solids)
centroid = Solid.Centroid(solid=byUnion)
watch_7 = Watch(centroid)
volume = Solid.Volume(solid=byUnion)
watch_8 = Watch(volume)
area = Solid.Area(solid=byUnion)
watch_9 = Watch(area)
