# Dynamo graph DataToExcel.dyn (Dynamo 2.19.3.6394)

# group: Get Rooms
categories = Categories("OST_Rooms")
all_elements_of_category = ElementsOfCategory(Category=categories)

# group: Get elements by category
categories_2 = Categories("OST_MechanicalEquipment")
current = Document.Current()
activeView = Document.ActiveView(document=current)
all_elements_of_category_in_view = ElementsOfCategoryInView(Category=categories_2, View=activeView)

# group: Check if elements are inside rooms
getLocation = Element.GetLocation(element=all_elements_of_category_in_view)
isInsideRoom = Room.IsInsideRoom(room=all_elements_of_category, point=getLocation@L1)
boolean = BoolSelector(true)
indexOf = List.IndexOf(list=isInsideRoom@L2, element=boolean)

# group: Data organization
string = StringInput("Department")
getParameterValueByName = Element.GetParameterValueByName(element=all_elements_of_category, parameterName=string)
elementType = Element.ElementType(element=all_elements_of_category_in_view)
string_2 = StringInput("Level")
getParameterValueByName_2 = Element.GetParameterValueByName(element=all_elements_of_category, parameterName=string_2)
getItemAtIndex = List.GetItemAtIndex(list=getParameterValueByName_2, index=indexOf)
getItemAtIndex_2 = List.GetItemAtIndex(list=getParameterValueByName, index=indexOf)
name = Room.Name(room=all_elements_of_category)
getItemAtIndex_3 = List.GetItemAtIndex(list=name, index=indexOf)
number = Room.Number(room=all_elements_of_category)
getItemAtIndex_4 = List.GetItemAtIndex(list=number, index=indexOf)
list_create = List.Create(item0=elementType, item1=getItemAtIndex, item2=getItemAtIndex_2, item3=getItemAtIndex_3, item4=getItemAtIndex_4)

# group: Get room solids
solids = Element.Solids(element=all_elements_of_category)
string_3 = StringInput("A")
allIndicesOf = List.AllIndicesOf(list=getParameterValueByName, item=string_3)
getItemAtIndex_5 = List.GetItemAtIndex(list=solids, index=allIndicesOf)
string_4 = StringInput("B")
allIndicesOf_2 = List.AllIndicesOf(list=getParameterValueByName, item=string_4)
getItemAtIndex_6 = List.GetItemAtIndex(list=solids, index=allIndicesOf_2)
string_5 = StringInput("C")
allIndicesOf_3 = List.AllIndicesOf(list=getParameterValueByName, item=string_5)
getItemAtIndex_7 = List.GetItemAtIndex(list=solids, index=allIndicesOf_3)

header = CodeBlock { ["Family Type", "Level", "Dept.", "Room Name", "Room Number"]; }
code_block = CodeBlock { 0; }

# group: excel format output
directory_path = Directory("C:\Users\ychiang2\Desktop\20250513")
code_block_2 = CodeBlock(D=directory_path) { D + "/equ_room_data.xlsx"; }
code_block_3 = CodeBlock { "data1"; }
code_block_4 = CodeBlock { 0; }
transpose = List.Transpose(lists=list_create)
insert = List.Insert(list=transpose, element=header, index=code_block)
exportToExcel = Data.ExportToExcel(filePath=code_block_2, sheetName=code_block_3, startRow=code_block_4, startColumn=code_block_4, data=insert)
