# Dynamo graph ExcelWorkaround.dyn (Dynamo 2.19.3.6394)
# packages: bimorphNodes 5.1.3

directory_path = Directory("C:\Users\ychiang2\Desktop\20250513\ExyteHelloWorld\ExyteDynamo")
code_block = CodeBlock { "Room Schedule"; }
code_block_2 = CodeBlock(D=directory_path, F=code_block) { D + "\\" + F+ ".xlsx"; }
code_block_3 = CodeBlock { 0; }
categories = Categories("OST_Schedules")
all_elements_of_category = ElementsOfCategory(Category=categories)
name = Element.Name(element=all_elements_of_category)
indexOf = List.IndexOf(list=name, element=code_block)
getItemAtIndex = List.GetItemAtIndex(list=all_elements_of_category, index=indexOf)
getData = Revit.Schedule.GetData(scheduleView=getItemAtIndex)
exportToExcel = Data.ExportToExcel(filePath=code_block_2, sheetName=code_block, startRow=code_block_3, startColumn=code_block_3, data=getData)
