# Dynamo graph Hello World.dyn (Dynamo 2.19.3.6394)

# group: Basic Nodes
integer_slider = IntegerSlider(1, range=0..100 step 1)
number = DoubleInput(0)
number_slider = DoubleSlider(1, range=0..100 step 0.1)
string = StringInput("Hello Exyte")
boolean = BoolSelector(false)

# group: Data Structure
number_2 = DoubleInput(2)
number_3 = DoubleInput(20)
number_4 = DoubleInput(3)
range = Range(start=number_2, end=number_3, step=number_4)
number_5 = DoubleInput(2)
number_6 = DoubleInput(10)
number_7 = DoubleInput(20)
sequence = Sequence(start=number_5, amount=number_6, step=number_7)
list_create = List.Create(item0=range, item1=sequence)
join = List.Join(list0=range, list1=sequence)

# group: Hello World
string_2 = StringInput("Hello Exyte")  # graph input
watch = Watch(string_2)  # graph output

# group: Geometry
number_slider_2 = DoubleSlider(60, range=0..100 step 0.1)
number_slider_3 = DoubleSlider(80, range=0..100 step 0.1)
number_slider_4 = DoubleSlider(100, range=0..100 step 0.1)
byLengths = Cuboid.ByLengths(width=number_slider_2, length=number_slider_3, height=number_slider_4)
number_8 = DoubleInput(0)
byCoordinates = Point.ByCoordinates(x=number_8, y=number_8, z=number_8)
byCoordinates_2 = Point.ByCoordinates(x=number_slider_2, y=number_slider_3, z=number_slider_4)
byCorners = Cuboid.ByCorners(lowPoint=byCoordinates, highPoint=byCoordinates_2)
